# Dynamo graph Circulation.dyn (Dynamo 2.0.2.6826)

file_path = Filename("Data\Features.xlsx")
code_block = CodeBlock { "1"; }
code_block_2 = CodeBlock { 1; }
file_path_2 = Filename("Data\circulation.csv")

# group: Circulation for each floor
categories = Categories(index=159)
all_elements_of_category = ElementsOfCategory(Category=categories)
level = Custom[Element.Level](element=all_elements_of_category)  # Gets an element's level
groupByKey = List.GroupByKey(list=all_elements_of_category, keys=level)
getLocation = Element.GetLocation(element=groupByKey.groups)
select_phase = RevitPhases(index=1)
rooms = Custom[Door.Rooms](door=all_elements_of_category, phase=select_phase)  # Gets the rooms that are connected by a given door
geometry = Element.Geometry(element=rooms.fromRoom)
centroid = Solid.Centroid(solid=geometry)
flatten = List.Flatten(list=centroid)
groupByKey_2 = List.GroupByKey(list=flatten, keys=level)
geometry_2 = Element.Geometry(element=rooms.toRoom)
centroid_2 = Solid.Centroid(solid=geometry_2)
flatten_2 = List.Flatten(list=centroid_2)
groupByKey_3 = List.GroupByKey(list=flatten_2, keys=level)
python_script = Python(IN[0]=getLocation, IN[1]=groupByKey_2.groups, IN[2]=groupByKey_3.groups)
# ---------- python_script.python (37 lines) ----------
# Enable Python support and load DesignScript library
import clr
import math
clr.AddReference('ProtoGeometry')
from Autodesk.DesignScript.Geometry import *

# The inputs to this node will be stored as a list in the IN variables.
dataEnteringNode = IN

# Place your code below this line

DOORS = IN[0]
TO_ROOMS = IN[1]
FROM_ROOMS = IN[2]

def distance(pt1, pt2):
	return math.hypot(pt2.X-pt1.X, pt2.Y-pt1.Y)

out = []

for doors, to_rooms, from_rooms in zip(DOORS, TO_ROOMS, FROM_ROOMS):
	circulation = [0]*360
	for door, to_room, from_room in zip(doors, to_rooms, from_rooms):
		if door is not None and from_room is not None:	
			angle_1 = int(math.degrees(math.atan2(door.Y-from_room.Y, door.X-from_room.Y)))
			circulation[angle_1] += distance(door, from_room)
		
		if door is not None and to_room is not None:
			angle_2 = int(math.degrees(math.atan2(to_room.Y-door.Y, to_room.X - door.X)))
			circulation[angle_2] += distance(to_room, door)
	
	circulation_norm = [x/ sum(circulation) for x in circulation]
			
	out.append(circulation_norm)

# Assign your output to the OUT variable.
OUT = out
# ----------------------------------------

transpose = List.Transpose(lists=python_script)
exportCSV = Data.ExportCSV(filePath=file_path_2, data=transpose)
boolean = BoolSelector(true)
