# Dynamo graph FeatureExtraction.dyn (Dynamo 2.0.2.6826)

# group: Space Wall Ratio - Measures the amount of spatial segregation
boolean = BoolSelector(true)
lunchbox_room_element_collector = Custom[LunchBox Room Element Collector](Toggle=boolean)  # Collects rooms from the Revit document
code_block = CodeBlock { "Area"; }
getParameterValueByName = Element.GetParameterValueByName(element=lunchbox_room_element_collector.Element, parameterName=code_block)
sum = Math.Sum(values=getParameterValueByName)
element_types = ElementTypes(index=341)
all_elements_of_type = ElementsOfType(element_type=element_types)
code_block_2 = CodeBlock { "Area"; }
getParameterValueByName_2 = Element.GetParameterValueByName(element=all_elements_of_type, parameterName=code_block_2)
sum_2 = Math.Sum(values=getParameterValueByName_2)
div = sum / sum_2

# group: Space Volume Mean and Variance
boolean_2 = BoolSelector(true)
lunchbox_room_element_collector_2 = Custom[LunchBox Room Element Collector](Toggle=boolean_2)
geometry = Element.Geometry(element=lunchbox_room_element_collector_2.Element)
volume = Solid.Volume(solid=geometry)
flatten = List.Flatten(list=volume)
code_block_3 = CodeBlock { 1000000000; }
div_2 = flatten / code_block_3
space_volume_mean = Math.Average(numbers=div_2)
file_path = Filename("Data\spacevolume.csv")
groupByKey = List.GroupByKey(list=div_2, keys=lunchbox_room_element_collector_2.Level_Name)
space_volume_variance = Python(IN[0]=groupByKey.groups, IN[1]=groupByKey.unique_keys)
# ---------- space_volume_variance.python (24 lines) ----------
# Enable Python support and load DesignScript library
import clr
clr.AddReference('ProtoGeometry')
from Autodesk.DesignScript.Geometry import *

# The inputs to this node will be stored as a list in the IN variables.
dataEnteringNode = IN

# Place your code below this line

VOLUMES = IN[0]
LEVELS= IN[1]

out_dict = {}

out = []

for index, volumes in enumerate(VOLUMES):
	mean = sum(volumes) / len(volumes)
	var = sum((xi - mean) ** 2 for xi in volumes) / len(volumes)
	out.append([mean, var])

# Assign your output to the OUT variable.
OUT = out
# ----------------------------------------
exportCSV = Data.ExportCSV(filePath=file_path, data=space_volume_variance)

# group: Space gyradius mean and variance
boolean_3 = BoolSelector(true)
lunchbox_room_element_collector_3 = Custom[LunchBox Room Element Collector](Toggle=boolean_3)
geometry_2 = Element.Geometry(element=lunchbox_room_element_collector_3.Element)
flatten_2 = List.Flatten(list=geometry_2)
centroid = Solid.Centroid(solid=flatten_2)
volume_2 = Solid.Volume(solid=flatten_2)
code_block_4 = CodeBlock { 1000000000; }
div_3 = volume_2 / code_block_4
centroid_of_the_floor = Python(IN[0]=centroid, IN[1]=div_3)  # "Centroid of the floor calculation"
# ---------- centroid_of_the_floor.python (29 lines) ----------
# Enable Python support and load DesignScript library
import clr
clr.AddReference('ProtoGeometry')
from Autodesk.DesignScript.Geometry import *

# The inputs to this node will be stored as a list in the IN variables.
dataEnteringNode = IN

# Place your code below this line

centroids = IN[0]
volumes = IN[1]

out = []
X = 0.0
Y = 0.0
Z = 0.0

total_volume = 0
for i in range(len(centroids)):
	X += volumes[i]*centroids[i].X
	Y += volumes[i]*centroids[i].Y
	Z += volumes[i]*centroids[i].Z
	total_volume += volumes[i]

out = Point.ByCoordinates(X/total_volume, Y/total_volume, Z/total_volume)

# Assign your output to the OUT variable.
OUT = out
# ----------------------------------------

# group: Foot Print of each level
categories = Categories(index=208)
all_elements_of_category = ElementsOfCategory(Category=categories)
geometry_3 = Element.Geometry(element=all_elements_of_category)
bySolid = PolySurface.BySolid(solid=geometry_3)
flatten_3 = List.Flatten(list=bySolid)
level = Custom[Element.Level](element=all_elements_of_category)  # Gets an element's level
groupByKey_2 = List.GroupByKey(list=flatten_3, keys=level)
radius_of_the_base_solid = CodeBlock { 80000; }
thickness_of_the_base_solid = CodeBlock { 20000; }
python_script = Python(IN[0]=radius_of_the_base_solid, IN[1]=thickness_of_the_base_solid, IN[2]=centroid_of_the_floor)
# ---------- python_script.python (29 lines) ----------
# Enable Python support and load DesignScript library
import clr
clr.AddReference('ProtoGeometry')
from Autodesk.DesignScript.Geometry import *

# The inputs to this node will be stored as a list in the IN variables.
dataEnteringNode = IN

# Place your code below this line

radius = IN[0]
thickness = IN[1]
centroid = IN[2]

angle_1 = [0, 20, 40, 60, 80, 100, 120, 140, 160, 180, 200, 220, 240, 260, 280, 300, 320, 340]
angle_2 = [20, 40, 60, 80, 100, 120, 140, 160, 180, 200, 220, 240, 260, 280, 300, 320, 340, 0]

out = []
for i in range(len(angle_1)):
	point_1 = Point.ByCylindricalCoordinates(CoordinateSystem.ByOrigin(0, 0, 0), angle_1[i], 0, radius)
	point_2 = Point.ByCylindricalCoordinates(CoordinateSystem.ByOrigin(0, 0, 0), angle_2[i], 0, radius)
	point_3 = centroid
	
	polygon = Polygon.ByPoints([point_1, point_2, point_3])
	solid = Surface.ByPatch(polygon).Thicken(thickness)
	out.append(solid)

# Assign your output to the OUT variable.
OUT = out
# ----------------------------------------
python_script_2 = Python(IN[0]=groupByKey_2.groups, IN[1]=python_script)
# ---------- python_script_2.python (33 lines) ----------
# Enable Python support and load DesignScript library
import clr
clr.AddReference('ProtoGeometry')
from Autodesk.DesignScript.Geometry import *

# The inputs to this node will be stored as a list in the IN variables.
dataEnteringNode = IN

# Place your code below this line

FLOOR_SURFACES = IN[0]
base_solids = IN[1]

out = []

for floor_surfaces in FLOOR_SURFACES:
	level_intersection = []
	for base_solid in base_solids:
		intersections = []
		for floor_surface in floor_surfaces:
			intersections += base_solid.Intersect(floor_surface)
		area = 0
		for intersection in intersections:
			area += intersection.Area/100000
		level_intersection.append(area)
		if sum(level_intersection) > 0:
			level_intersection_norm = [float(i)/sum(level_intersection) for i in level_intersection]
		else:
			level_intersection_norm = level_intersection
	out.append(level_intersection_norm)		
	
# Assign your output to the OUT variable.
OUT = out
# ----------------------------------------

transpose = List.Transpose(lists=python_script_2)

# group (continued): Foot Print of each level
exportCSV_2 = Data.ExportCSV(data=transpose)  # unwired: filePath

# group: Doors per space - Measures the connectivity of spaces
file_path_2 = Filename("Data\doorsperspace.csv")
boolean_4 = BoolSelector(true)
lunchbox_room_element_collector_4 = Custom[LunchBox Room Element Collector](Toggle=boolean_4)
doors = Custom[Room.Doors](room=lunchbox_room_element_collector_4.Element)  # Retrieves all doors that are associated with a room (hosted in walls and roofs).
groupByKey_3 = List.GroupByKey(list=doors, keys=lunchbox_room_element_collector_4.Level_Name)
doors_per_space = Python(IN[0]=groupByKey_3.groups)
# ---------- doors_per_space.python (22 lines) ----------
# Enable Python support and load DesignScript library
import clr
clr.AddReference('ProtoGeometry')
from Autodesk.DesignScript.Geometry import *

# The inputs to this node will be stored as a list in the IN variables.
dataEnteringNode = IN

# Place your code below this line

DOORS = IN[0]

out = []

for rooms in DOORS:
	total_rooms = len(rooms)
	total_doors = 0.0
	for doors in rooms:
		total_doors += len(doors)
	out.append(total_doors*1.0/total_rooms)
# Assign your output to the OUT variable.
OUT = out
# ----------------------------------------
exportCSV_3 = Data.ExportCSV(filePath=file_path_2, data=doors_per_space)

# group: Space gyradius mean and variance
file_path_3 = Filename("Data\gyradius.csv")
boolean_5 = BoolSelector(true)
lunchbox_room_element_collector_5 = Custom[LunchBox Room Element Collector](Toggle=boolean_5)
geometry_4 = Element.Geometry(element=lunchbox_room_element_collector_5.Element)
flatten_4 = List.Flatten(list=geometry_4)
groupByKey_4 = List.GroupByKey(list=flatten_4, keys=lunchbox_room_element_collector_5.Level_Name)
centroid_2 = Solid.Centroid(solid=groupByKey_4.groups)
volume_3 = Solid.Volume(solid=groupByKey_4.groups)
code_block_5 = CodeBlock { 1000000000; }
div_4 = volume_3 / code_block_5
centroid_of_the_floor_2 = Python(IN[0]=centroid_2, IN[1]=div_4)  # "Centroid of the floor calculation"
# ---------- centroid_of_the_floor_2.python (30 lines) ----------
# Enable Python support and load DesignScript library
import clr
clr.AddReference('ProtoGeometry')
from Autodesk.DesignScript.Geometry import *

# The inputs to this node will be stored as a list in the IN variables.
dataEnteringNode = IN

# Place your code below this line

CENTROIDS = IN[0]
VOLUMES = IN[1]

out = []
for centroids, volumes in zip(CENTROIDS, VOLUMES):
	X = 0.0
	Y = 0.0
	Z = 0.0
	
	total_volume = 0
	for i in range(len(centroids)):
		X += volumes[i]*centroids[i].X
		Y += volumes[i]*centroids[i].Y
		Z += volumes[i]*centroids[i].Z
		total_volume += volumes[i]
	
	out.append(Point.ByCoordinates(X/total_volume, Y/total_volume, Z/total_volume))

# Assign your output to the OUT variable.
OUT = out
# ----------------------------------------
space_gyraidus = Python(IN[0]=centroid_of_the_floor_2, IN[1]=centroid_2)
# ---------- space_gyraidus.python (35 lines) ----------
# Enable Python support and load DesignScript library
import clr
import math
clr.AddReference('ProtoGeometry')
from Autodesk.DesignScript.Geometry import *

# The inputs to this node will be stored as a list in the IN variables.
dataEnteringNode = IN

# Place your code below this line

CENTROID = IN[0]
ALL_CENTROIDS = IN[1]

out = []

# Distance between two points
def point_distance_squared(pt1, pt2):
	return math.sqrt(pow(pt1.X - pt2.X, 2) + pow(pt1.Y - pt2.Y, 2))

# Given centroids of rooms and the building centroid calculate the mean & variance of the distances between the centroids
for centroid, all_centroids in zip(CENTROID, ALL_CENTROIDS):
	
	gy_radii = []
	
	for room_centroid in all_centroids:
		gy_radii.append(point_distance_squared(room_centroid, centroid))
	
	gy_radius_mean = sum(gy_radii) / len(gy_radii)
	gy_radius_var = sum((xi - gy_radius_mean) ** 2 for xi in gy_radii) / len(gy_radii)
	
	out.append([gy_radius_mean, gy_radius_var])

# Assign your output to the OUT variable.
OUT = out
# ----------------------------------------
exportCSV_4 = Data.ExportCSV(filePath=file_path_3, data=space_gyraidus)

# group: Foot Print of each level
categories_2 = Categories(index=208)
all_elements_of_category_2 = ElementsOfCategory(Category=categories_2)
geometry_5 = Element.Geometry(element=all_elements_of_category_2)
bySolid_2 = PolySurface.BySolid(solid=geometry_5)
flatten_5 = List.Flatten(list=bySolid_2)
level_2 = Custom[Element.Level](element=all_elements_of_category_2)
groupByKey_5 = List.GroupByKey(list=flatten_5, keys=level_2)
radius_of_the_base_solid_2 = CodeBlock { 80000; }
thickness_of_the_base_solid_2 = CodeBlock { 20000; }
python_script_3 = Python(IN[0]=radius_of_the_base_solid_2, IN[1]=thickness_of_the_base_solid_2, IN[2]=centroid_of_the_floor)  # same code as python_script
python_script_4 = Python(IN[0]=groupByKey_5.groups, IN[1]=python_script_3)  # same code as python_script_2
file_path_4 = Filename("Data\footprint.csv")
exportCSV_5 = Data.ExportCSV(filePath=file_path_4, data=transpose)
