# Dynamo graph Orientation.dyn (Dynamo 2.0.2.6826)

file_path = Filename("Data\orientation.csv")

# group: Orientation
element_types = ElementTypes(index=341)
all_elements_of_type = ElementsOfType(element_type=element_types)
orientation = Custom[Wall.Orientation](wall=all_elements_of_type)  # Gets the orientation of a given wall instance (normal of the exterior face of the wall). Will *not* work for walls hosted on mass faces or in-place walls.
level = Custom[Element.Level](element=all_elements_of_type)  # Gets an element's level
groupByKey = List.GroupByKey(list=orientation, keys=level)
code_block = CodeBlock { "Length"; }
getParameterValueByName = Element.GetParameterValueByName(element=all_elements_of_type, parameterName=code_block)
groupByKey_2 = List.GroupByKey(list=getParameterValueByName, keys=level)
sum = Math.Sum(values=groupByKey_2.groups)
python_script = Python(IN[0]=groupByKey.groups, IN[1]=groupByKey_2.groups, IN[2]=sum)
# ---------- python_script.python (26 lines) ----------
# Enable Python support and load DesignScript library
import clr
import math
clr.AddReference('ProtoGeometry')
from Autodesk.DesignScript.Geometry import *

# The inputs to this node will be stored as a list in the IN variables.
dataEnteringNode = IN

# Place your code below this line

NORMALS = IN[0]
LENGTHS = IN[1]
TOTAL_LENGTHS = IN[2]

out = []

for normals, lengths, total_length in zip(NORMALS, LENGTHS, TOTAL_LENGTHS):
	orientation = [0]*360
	for index, normal in enumerate(normals):
		angle = int(math.atan2(normal.Y, normal.X)/math.pi*180)
		orientation[angle] += lengths[index]
	orientation_norm = [x / total_length for x in orientation]
	out.append(orientation_norm)
# Assign your output to the OUT variable.
OUT = out
# ----------------------------------------

transpose = List.Transpose(lists=python_script)
exportCSV = Data.ExportCSV(filePath=file_path, data=transpose)
